# Dynamo graph 02_Surface_Painting.dyn (Dynamo 1.3.0.862)

connectToVive = Start.ConnectToVive()
boolean = BoolSelector(true)
controller1 = Devices.Controller1(connectToVive.out1, arg2=boolean)
boolean_2 = BoolSelector(false)
boolean_3 = BoolSelector(false)
genericTracker = Devices.GenericTracker(connectToVive.out1, arg2=boolean_2, arg3=boolean_3)
code_block = CodeBlock { 1; }
genericTracker_2 = Devices.GenericTracker(connectToVive.out1, code_block, boolean_2, boolean_3)
controller2 = Devices.Controller2(connectToVive.out1, boolean_2, boolean_3)
HMD = Devices.HMD(connectToVive.out1, boolean_2, boolean_3)
lighthouse1 = Devices.Lighthouse1(connectToVive.out1, boolean_2, boolean_3)
lighthouse2 = Devices.Lighthouse2(connectToVive.out1, boolean_2, boolean_3)
